# Dynamo graph BasicConnection.dyn (Dynamo 1.3.0.875)

code_block = CodeBlock { 2; }
byCoordinates = Point.ByCoordinates(z=code_block)
YAxis = Vector.YAxis()
ZAxis = Vector.ZAxis()
rotate = DoubleSlider(20.4, range=-180..180 step 0.1)
rotate_2 = Vector.Rotate(YAxis, ZAxis, rotate)
XAxis = Vector.XAxis()
create = List.Create(rotate_2, XAxis)
member_length = DoubleSlider(28.9, range=0..100 step 0.1)
byStartPointDirectionLength = Line.ByStartPointDirectionLength(startPoint=byCoordinates, direction=create, length=member_length)
code_block_2 = CodeBlock { 0.001; }
boolean = BoolSelector(false)
fromLines = HowickMaker.hStructure.FromLines(byStartPointDirectionLength, code_block_2, boolean)
