# Dynamo graph TConnection.dyn (Dynamo 1.3.0.875)

code_block = CodeBlock { 2; 10; }
byCoordinates = Point.ByCoordinates(x=code_block.out1, z=code_block.out0)
byCoordinates_2 = Point.ByCoordinates(z=code_block.out0)
create = List.Create(byCoordinates, byCoordinates_2)
YAxis = Vector.YAxis()
ZAxis = Vector.ZAxis()

# group: Member Parameters
rotate = DoubleSlider(26.3, range=-180..180 step 0.1)
member_length = DoubleSlider(27.3, range=0..100 step 0.1)

rotate_2 = Vector.Rotate(YAxis, ZAxis, rotate)
XAxis = Vector.XAxis()
create_2 = List.Create(rotate_2, XAxis)
byStartPointDirectionLength = Line.ByStartPointDirectionLength(startPoint=create, direction=create_2, length=member_length)
fromLines = HowickMaker.hStructure.FromLines(byStartPointDirectionLength)
